# Grasshopper definition 2025_07-21 StudyForTheatreCirculation.gh (Grasshopper 1.0.8)

starting_point_for_hemicircle = Point("0,0,0")
starting_point_for_hemicircle_2 = Point("0,20,0")
panel = Panel("Datum for Stage")
X = UnitX(Factor=Slider(90, range=0..100))
X_2 = UnitX(Factor=Slider(90, range=0..100))
Z = UnitZ(Factor="6/12")
number_slider = Slider(60, range=0..100)
number_slider_2 = Slider(60, range=0..100)
move = Move(Geometry=starting_point_for_hemicircle, Motion=X_2)  # -> Geometry, Transform
theatre_origin = Point(starting_point_for_hemicircle_2)
move_2 = Move(Geometry=starting_point_for_hemicircle_2, Motion=Z)  # -> Geometry, Transform
theatre_origin_2 = Point(starting_point_for_hemicircle)
division = Division(A=number_slider, B="6/12")
division_2 = Division(A=number_slider_2, B="6/12")
ln = Line(StartPoint=theatre_origin, EndPoint=move_2.Geometry)
Z_2 = UnitZ(Factor=number_slider)
Z_3 = UnitZ(Factor=number_slider_2)
move_3 = Move(Geometry=move.Geometry, Motion=Z_2)  # -> Geometry, Transform
move_4 = Move(Geometry=move_2.Geometry, Motion=Z_3)  # -> Geometry, Transform
series = Series(Start=0, Step="6/12", Count=division)
xy = XYPlane(Origin=theatre_origin_2)
series_2 = Series(Start=0, Step="6/12", Count=division_2)
xy_2 = XYPlane(Origin=theatre_origin)
Z_4 = UnitZ(Factor=series)
Z_5 = UnitZ(Factor=series_2)
number_slider_3 = Slider(0.7, range=0..2)
move_5 = Move(Geometry=xy, Motion=Z_4)  # -> Geometry, Transform
ln_2 = Line(StartPoint=theatre_origin_2, EndPoint=move_3.Geometry)
move_6 = Move(Geometry=xy_2, Motion=Z_5)  # -> Geometry, Transform
panel_3 = Panel("11/12")
neg = Negative(Value="11/12")
pcx = CurvePlane(Curve=ln_2, Plane=move_5.Geometry)  # -> flatten(Points), ParamsC, ParamsP
X_3 = UnitX(Factor=neg)
move_7 = Move(Geometry=pcx.Points, Motion=X_3)  # -> Geometry, Transform
shift = ShiftList(List=pcx.Points, Shift=-1, Wrap=True)
ln_3 = Line(StartPoint=pcx.Points, EndPoint=move_7.Geometry)
